# Grasshopper definition gh_basics_Curve_003.gh (Grasshopper 1.0.7)
# plug-ins: Kangaroo2 Components

# ----
# Parameters
x = Slider(-0.77, range=-5..5)
y = Slider(2.73, range=-5..5)
z = Slider(-0.97, range=-5..5)
divide_length = Slider(6, range=1..10)
rotation = Slider(-0.46, range=-2..2)
number_slider = Slider(5, range=-5..5)
seed = Slider(435, range=0..1000)
count = Slider(11, range=0..30)
reduced = Slider(15, range=0..22)
seed_2 = Slider(269, range=0..1000)

# ----
# Domains
construct_domain = ConstructDomain(DomainStart=Slider(-5, range=-5..5), DomainEnd=number_slider)
rectangle = Rectangle(Plane=PlaneXY(0, 0, 0), XSize=construct_domain, YSize=construct_domain, Radius=0)  # -> Rectangle, Length
sphere = Sphere(Base=PlaneXY(0, 0, 0), Radius=number_slider)
center_box = CenterBox(Base=rectangle.Rectangle, X=number_slider, Y=number_slider, Z=number_slider)

construct_point = ConstructPoint(XCoordinate=x, YCoordinate=y, ZCoordinate=z)
boolean_toggle = BooleanToggle(True)
vector_xyz = VectorXYZ(XComponent="1", YComponent=0, ZComponent=0)  # -> Vector, Length
pi = Pi(Factor=Slider(0.26, range=0..2))
pi_2 = Pi(Factor=Slider(1.4, range=0..2))
construct_domain_2 = ConstructDomain(DomainStart=pi, DomainEnd=pi_2)

# ----
# Rhino 7 Educational Lab
# gh_basics_Curve_002
# Rhino Menu Bar
# Rhino
# Commands
# CURVE
# Point Cloud
# Create Point
# Cloud
# Rhino
# Commands
# Add Points
# Remove Points
populate_2d = Populate2D(Region=rectangle.Rectangle, Count=count, Seed=seed)
populate_3d = Populate3D(Region=center_box, Count=count, Seed=seed)
populate_geometry = PopulateGeometry(Geometry=sphere, Count=count, Seed=seed)

# ----
# Transformations
pi_3 = Pi(Factor=rotation)
rotate_3d = Rotate3D(Geometry=populate_3d, Angle=pi_3, Center=Point(0, 0, 0), Axis=Vector(0, 0, 1))  # -> Geometry, Transform

# ----
# Geometry
point = Point(populate_3d)
point_2 = Point(populate_geometry)
point_3 = Point(populate_2d)
point_4 = Point(populate_3d)
point_5 = Point(populate_geometry)
point_6 = Point(rotate_3d.Geometry)

merge = Merge(Data1=point, Data2=point_2)

list_length = ListLength(List=merge)
division = Division(A=list_length, B=divide_length)
integer = Integer(division)
series = Series(Start=0, Step=1, Count=integer)
replace_items = ReplaceItems(List=merge, Indices=series, Wrap=False)

panel = Panel(list_length)
random_reduce = RandomReduce(List=merge, Reduction=reduced, Seed=seed_2)
cull_index = CullIndex(List=merge, Indices=series, Wrap=True)

point_7 = Point(replace_items)
point_8 = Point(cull_index)
point_9 = Point(random_reduce)

# ----
# Param Viewer
# (Data Structure)
# Panels
replace_nulls = ReplaceNulls(Items=point_7, Replacements=construct_point)  # -> Items, Count
clean_tree = CleanTree(RemoveNulls=boolean_toggle, RemoveInvalid=boolean_toggle, RemoveEmpty=boolean_toggle, Tree=point_7)
panel_3 = Panel(point_5)
panel_4 = Panel(point_4)
panel_5 = Panel(point_6)
panel_6 = Panel(point_3)
panel_7 = Panel(point_8)
panel_8 = Panel(replace_nulls.Items)
panel_9 = Panel(replace_nulls.Count)
panel_10 = Panel(point_9)
param_viewer = ParamViewer(panel_7)
param_viewer_2 = ParamViewer(panel_8)
param_viewer_3 = ParamViewer(panel_6)
param_viewer_4 = ParamViewer(panel_4)
param_viewer_5 = ParamViewer(panel_3)
param_viewer_6 = ParamViewer(panel_5)
param_viewer_7 = ParamViewer(panel_10)

panel_11 = Panel(clean_tree)
param_viewer_8 = ParamViewer(panel_11)

# ----
# SANDBOX
# (Playground)
deconstruct = Deconstruct(Point=point_3)  # -> XComponent, YComponent, ZComponent
deconstruct_2 = Deconstruct(Point=point_3)  # -> XComponent, YComponent, ZComponent
sort_list = SortList(Keys=deconstruct_2.XComponent, ValuesValuesA=point_3)  # -> Keys, ValuesValuesA
sort_list_2 = SortList(Keys=deconstruct.YComponent, ValuesValuesA=point_3)  # -> Keys, ValuesValuesA
interpolate = Interpolate(Vertices=sort_list_2.ValuesValuesA, Degree=3, Periodic=False, KnotStyle=1)  # -> Curve, Length, Domain
unit_z = UnitZ(Factor=Slider(4.08, range=0..10))
interpolate_2 = Interpolate(Vertices=sort_list.ValuesValuesA, Degree=3, Periodic=False, KnotStyle=1)  # -> Curve, Length, Domain
move = Move(Geometry=interpolate.Curve, Motion=unit_z)  # -> Geometry, Transform
gene_pool = GenePool(Decimals=2, Maximum=1, Minimum=0, Value=[0.07, 0.26, 0.6, 0.81, 0.97])
curve = Curve(interpolate_2.Curve)
flip_curve = FlipCurve(Curve=curve)  # -> Curve, Flag
series_2 = Series(Start="3", Step="1", Count="3")
curve_2 = Curve(move.Geometry)
entwine = Entwine(Branch00=clean_tree, Branch01=point_8, Branch02=point_9, FlattenInputs=True)
evaluate_curve = EvaluateCurve(Curve=reparameterize(flip_curve.Curve), Parameter=gene_pool)  # -> Point, Tangent, Angle
evaluate_curve_2 = EvaluateCurve(Curve=reparameterize(curve_2), Parameter=gene_pool)  # -> Point, Tangent, Angle
graft_tree = GraftTree(Tree=series_2, IncludeEmptyLists=True, IncludeNullItems=True)
number_slider_2 = Slider(0.08, range=0..1)
average = Average(Input=evaluate_curve_2.Point)
polygon = Polygon(Plane=entwine, Radius=graft_tree, Segments=graft_tree, FilletRadius=0)  # -> Polygon, Length
line = Line(StartPoint=evaluate_curve.Point, EndPoint=evaluate_curve_2.Point)
radius = Slider(0.71, range=0..1)
stream_gate = Slider(1, range=0..2)
explode_tree = ExplodeTree(Data=polygon.Polygon)  # -> Branch0, Branch1, Branch2
ellipse = Ellipse(Plane=average, Radius1=Slider(9.18, range=0..10), Radius2=Slider(5.02, range=0..10))  # -> Ellipse, Focus1, Focus2
addition = Addition(A=number_slider_2, B=Slider(0.15, range=0..1))
boundary_surfaces = BoundarySurfaces(Edges=ellipse.Ellipse)
stream_filter = StreamFilter(Gate=stream_gate, Stream0=explode_tree.Branch0, Stream1=explode_tree.Branch1, Stream2=explode_tree.Branch2)
unit_z_2 = UnitZ(Factor=addition)
area = Area(Geometry=stream_filter)  # -> Area, Centroid
extrude = Extrude(Base=boundary_surfaces, Direction=unit_z_2)
multipipe = MultiPipe(
    Curves=line,
    NodeSize=number_slider_2,
    EndOffset=1,
    StrutSize=1,
    Segment=0,
    KinkAngle=0.6,
    CubeFit=0,
    Caps=Slider(1, range=0..2))
pipe = Pipe(Curve=[flip_curve.Curve, curve_2], Radius=number_slider_2, Caps=0)

explode = Explode(Curve=explode_tree.Branch0, Recursive=True)  # -> Segments, Vertices
explode_2 = Explode(Curve=explode_tree.Branch1, Recursive=True)  # -> Segments, Vertices
explode_3 = Explode(Curve=explode_tree.Branch2, Recursive=True)  # -> Segments, Vertices
curve_middle = CurveMiddle(Curve=explode.Segments)
curve_middle_2 = CurveMiddle(Curve=explode_2.Segments)
curve_middle_3 = CurveMiddle(Curve=explode_3.Segments)
list_length_2 = ListLength(List=area.Centroid)
line_sdl = LineSDL(Start=curve_middle_3, Direction=vector_xyz.Vector, Length=1)
range = Range(Domain=construct_domain_2, Steps=expr("x-1", list_length_2))
rotate_3d_2 = Rotate3D(Geometry=graft(stream_filter), Angle=graft(range), Center=graft(area.Centroid), Axis=line_sdl)  # -> Geometry, Transform
multipipe_2 = MultiPipe(Curves=rotate_3d_2.Geometry, NodeSize=radius, EndOffset=1, StrutSize=1, Segment=0, KinkAngle=0.6, CubeFit=0, Caps=0)
